# Grasshopper definition ph_nav_v2_example.hbjson.ghx (Grasshopper 1.0.8)

brep = Brep([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])
graft_tree = GraftTree(Tree=brep, IncludeEmptyLists=True, IncludeNullItems=True)  # -> simplify(Tree)
roomsolid = HBRoomFromSolid(geo=simplify(graft_tree), conditioned=True)  # -> out, rooms; plug-in component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
solveadj = HBSolveAdjacency(rooms=flatten(roomsolid.rooms), run=Toggle(True))  # -> out, adj_rooms; plug-in component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
aperturesbyratio = HBAperturesByRatio(hb_objs=flatten(solveadj.adj_rooms), ratio="0.3", subdivide=Toggle(True))  # -> out, hb_objs; plug-in component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
create_spaces_from_rooms = HBPHCreateSpacesFromHBRooms(hb_rooms=aperturesbyratio.hb_objs)  # -> out, hb_rooms; inputs hb_rooms: list; plug-in component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

set_dwelling = HBPHSetDwelling(num_dwellings=simplify("1"), hb_rooms=simplify(create_spaces_from_rooms.hb_rooms))  # -> out, hb_rooms; inputs num_dwellings: tree, hb_rooms: tree; plug-in component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
set_res_occupancy = HBPHSetResOccupancy(num_bedrooms="1", num_people="1", hb_rooms=set_dwelling.hb_rooms)  # -> out, hb_rooms; inputs num_bedrooms: list of Int32, num_people: list of Int32, set_res_schedule: Boolean, hb_rooms: list; plug-in component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
hbph_ph_appliance_types = HBPHPHApplianceTypes({"1-dishwasher", "2-clothes_washer", "3-clothes_dryer", "4-fridge", "5-freezer", "6-fridge_freezer", "7-cooking", "13-PHIUS_MEL", "14-PHIUS_Lighting_Int", "15-PHIUS_Lighting_Ext", "16-PHIUS_Lighting_Garage", "11-Custom_Electric_per_Year", "17-Custom_Electric_Lighting_per_Year", "18-Custom_Electric_MEL_per_Use", "21-Commercial_Dishwasher", "22-Commercial_Refrigerator", "23-Commercial_Cooking", "24-Commercial_Custom", "100-Phius_Defaults": "100-Phius _Defaults", "200-PHI_Defaults"}, selected="100-Phius_Defaults")
add_process_equipment = HBPHAddProcessEquipment(
    equipment=hbph_ph_appliance_types,
    num_bedrooms="1",
    num_occupants="1",
    num_dwellings="1",
    hb_rooms=set_res_occupancy.hb_rooms)  # -> out, hb_rooms; inputs equipment: list, hb_rooms: list; plug-in component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

curve = Curve(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)
curve_2 = Curve(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)
create_duct = HBPHCreateVentilationDuct(geometry=curve)  # -> out, vent_duct; inputs geometry: list of GeometryBase, insul_reflective: Boolean; plug-in component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
create_duct_2 = HBPHCreateVentilationDuct(geometry=curve_2)  # -> out, vent_duct; inputs geometry: list of GeometryBase, insul_reflective: Boolean; plug-in component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
ph_ventilator = HBPHVentilator()  # -> out, flatten(unit); inputs frost_protection: Boolean, inside: Boolean; plug-in component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
create_vent = HBPHCreateVentilationSystem(system_type=ph_ventilator.unit, duct_01=create_duct.vent_duct, duct_02=create_duct_2.vent_duct)  # -> out, vent_system; inputs duct_01: list, duct_02: list; plug-in component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
add_mech = HBPHAddMechSystems(ventilation_system=create_vent.vent_system, hb_rooms=add_process_equipment.hb_rooms)  # -> out, hb_rooms; inputs space_conditioning_systems: list, supportive_devices: list, hb_rooms: list; plug-in component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

curve_3 = Curve(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)
create_fixture_twig_pipes = HBPHCreateSHWPipeFixtures(geometry=curve_3)  # -> out, dhw_fixture_piping; inputs display_name: list, material: list, diameter: list, water_temp: list, geometry: list of GeometryBase; plug-in component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
create_shw_sys = HBPHCreateSHWSystem(distribution_piping=create_fixture_twig_pipes.dhw_fixture_piping)  # -> out, hb_shw; inputs heaters: list, distribution_piping: list, num_tap_points: Int32, recirc_piping: list; plug-in component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
apply_shw_sys = HBPHApplySHWSystem(hb_shw=create_shw_sys.hb_shw, hb_rooms=add_mech.hb_rooms)  # -> out, flatten(hb_rooms); inputs hb_rooms: list; plug-in component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

file_path = FilePath("/Users/em/Dropbox/bldgkraft/Codes & Standards/PHIUS/Climate Data Sets/2022 - Text Files (for Macs)/USA/NY/NEW_YORK_J_F_KENNEDY_INT_AR_NY-mon.txt")
create_site_from_file = HBPHCreateSiteFromPhiusFile(source_file_path=file_path)  # -> out, site; plug-in component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
ph_bldg_segment = HBPHBldgSegment(site=create_site_from_file.site, hb_rooms=simplify(flatten(apply_shw_sys.hb_rooms)))  # -> out, hb_rooms; inputs num_floor_levels: Int32, num_dwelling_units: Int32, source_energy_factors: list, co2e_factors: list, hb_rooms: list; plug-in component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

brep_2 = Brep([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])
shade = HBShade(geo=brep_2)  # -> out, shades; plug-in component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
model = HBModel(rooms=flatten(ph_bldg_segment.hb_rooms), shades=flatten(shade.shades), name="ph_nav_v2_example")  # -> out, model; plug-in component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
file_path_2 = FilePath("/Users/em/Dropbox/bldgtyp-00/00_PH_Tools/ph-navigator-v2/planning/features/model-viewer/")
dumpobjects = HBDumpObjects(hb_objs=flatten(model.model), name="ph_nav_v2_example", folder=file_path_2, indent="2", dump=Toggle(False))  # -> out, hb_file; plug-in component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
